# Dynamo graph ChangeSysPath.dyn (Dynamo 2.0.3.8810)

string = StringInput("ChangeSysPath.py")  # graph input
file_from_path = FileObject(path=string)
readText = FileSystem.ReadText(file=file_from_path)
boolean = BoolSelector(false)
python_script_from_string = PythonStringNode(script=readText, IN[0]=file_from_path, IN[1]=boolean)
